# Grasshopper definition Baseplate_parametric.gh (Grasshopper 1.0.7)

thickness_material_spines_mm = Slider(2, range=2..20)
thickness_material_base_mm = Slider(2, range=0..5)
radius_base_plate = Slider(75, range=50..100)
number_spines = Slider(12, range=2..20)
y_coordinate_start = Slider(0, range=0..10)
depth_cut_base = Slider(10, range=2..20)
x_coordinate_start = Slider(0, range=0..10)
Z = UnitZ(Factor=thickness_material_base_mm)
pt = ConstructPoint(XCoordinate=x_coordinate_start, YCoordinate=y_coordinate_start, ZCoordinate=0)
cir = Circle(Plane=pt, Radius=radius_base_plate)
division = Division(A="6.28318530718", B=number_spines)
division_2 = Division(A=depth_cut_base, B="2")
division_3 = Division(A=thickness_material_spines_mm, B="2")
divide = DivideCurve(Curve=cir, Count=number_spines, Kinks=False)  # -> Points, Tangents, Parameters
pt_2 = ConstructPoint(XCoordinate=0, YCoordinate=0, ZCoordinate=0)
pt_3 = ConstructPoint(XCoordinate=0, YCoordinate=0, ZCoordinate=0)
pt_4 = ConstructPoint(XCoordinate=0, YCoordinate=0, ZCoordinate=0)
pt_5 = ConstructPoint(XCoordinate=0, YCoordinate=0, ZCoordinate=0)
pt_6 = ConstructPoint(XCoordinate=0, YCoordinate=0, ZCoordinate=0)
extr = Extrude(Base=cir, Direction=Z)
subtraction = Subtraction(A=radius_base_plate, B=division_2)
subtraction_2 = Subtraction(A="0", B=division_3)
series = Series(Start=division, Step=division, Count=number_spines)
pt_7 = ConstructPoint(XCoordinate=subtraction_2, YCoordinate=subtraction, ZCoordinate=0)
panel = Panel(series)
rectangle = Rectangle(Plane=pt_7, XSize=thickness_material_spines_mm, YSize=depth_cut_base, Radius=0)  # -> Rectangle, Length
rotate = Rotate(Geometry=rectangle.Rectangle, Angle=panel, Plane=pt)  # -> Geometry, Transform
Z_2 = UnitZ(Factor=depth_cut_base)
cap = CapHoles(Brep=extr)
extr_2 = Extrude(Base=rotate.Geometry, Direction=Z_2)
sdiff = SolidDifference(BrepsA=cap, BrepsB=extr_2)
