# Grasshopper definition Parametric Spline.gh (Grasshopper 1.0.7)

curve_outerpoint_x = Slider(65, range=50..150)
height_outercurver_mm = Slider(350, range=200..400)
thickness_spline = Slider(1, range=0..5)
thickness_baseplate_top = Slider(5, range=0..5)
depth_cut_mm = Slider(15, range=0..20)
thickness_baseplate_bottom = Slider(5, range=0..5)
width_curve = Slider(-30, range=-50..0)
division = Division(A=height_outercurver_mm, B="2")
pt = ConstructPoint(XCoordinate=curve_outerpoint_x, YCoordinate=division, ZCoordinate=0)
pt_2 = ConstructPoint(XCoordinate="0", YCoordinate=height_outercurver_mm, ZCoordinate=0)
pt_3 = ConstructPoint(XCoordinate="0", YCoordinate="0", ZCoordinate=0)
subtraction = Subtraction(A="50", B=thickness_baseplate_bottom)
pt_4 = ConstructPoint(XCoordinate="0", YCoordinate="300", ZCoordinate=0)
pt_5 = ConstructPoint(XCoordinate="0", YCoordinate=subtraction, ZCoordinate=0)
arc = Arc3Pt(PointA=pt_2, PointB=pt, PointC=pt_3)  # -> Arc, Plane, Radius
end = EndPoints(Curve=arc.Arc)  # -> Start, End
offset = OffsetCurve(Curve=arc.Arc, Distance=width_curve, Corners=1)
ln = Line(StartPoint=end.Start, EndPoint=end.End)
join = JoinCurves(Curves=[arc.Arc, ln], Preserve=False)
boundary = BoundarySurfaces(Edges=join)
Z = UnitZ(Factor=thickness_spline)
srfsplit = SurfaceSplit(Surface=boundary, Curves=offset)
item = ListItem(List=srfsplit, Index="1", Wrap=True)
extr = Extrude(Base=item, Direction=Z)
rectangle = Rectangle(Plane=pt_5, XSize=depth_cut_mm, YSize=thickness_baseplate_bottom, Radius=0)  # -> Rectangle, Length
rectangle_2 = Rectangle(Plane=pt_4, XSize=depth_cut_mm, YSize=thickness_baseplate_top, Radius=0)  # -> Rectangle, Length
Z_2 = UnitZ(Factor=thickness_spline)
Z_3 = UnitZ(Factor=thickness_spline)
extr_2 = Extrude(Base=rectangle_2.Rectangle, Direction=Z_2)
extr_3 = Extrude(Base=rectangle.Rectangle, Direction=Z_3)
sdiff = SolidDifference(BrepsA=extr, BrepsB=[extr_2, extr_3])
